% Requirement links of Controller.slx (R2017b)

block :108 links to req.slreqx#1: SE_001: Maintain speed
block :108 links to req.slreqx#2: SE_002: Set desired speed
block :108 links to req.slreqx#5: SE_002_01: PID control -plant assumptions
block :108 links to req.slreqx#6: SE_002_02: PID control - setting time
block :108 links to req.slreqx#1: SE_001: Maintain speed
block :33 links to req.slreqx#1: SE_001: Maintain speed
block :33 links to req.slreqx#2: SE_002: Set desired speed
block :33 links to req.slreqx#5: SE_002_01: PID control -plant assumptions
block :33 links to req.slreqx#6: SE_002_02: PID control - setting time
block :33 links to req.slreqx#1: SE_001: Maintain speed
block :76 links to req.slreqx#1: SE_001: Maintain speed
block :76 links to req.slreqx#2: SE_002: Set desired speed
block :76 links to req.slreqx#5: SE_002_01: PID control -plant assumptions
block :76 links to req.slreqx#6: SE_002_02: PID control - setting time
block :76 links to req.slreqx#1: SE_001: Maintain speed