% Requirement links of automodel.slx (R2017b)

block :108 links to req.slreqx#1: SE_001: Maintain speed
block :75 links to statechart_resuirements.slreqx#1: ST_01: Activate
block :75 links to statechart_resuirements.slreqx#5: ST_02: Show speed
block :75 links to statechart_resuirements.slreqx#6: ST_03_01: Accelerate with pedal
block :76 links to req.slreqx#1: SE_001: Maintain speed
block :76 links to req.slreqx#2: SE_002: Set desired speed
block :76 links to req.slreqx#5: SE_002_01: PID control -plant assumptions
block :76 links to req.slreqx#6: SE_002_02: PID control - setting time
block :76 links to req.slreqx#1: SE_001: Maintain speed
block :76 links to req.slreqx#8: S3_003: Maintain speed on slope