# Requirement set statechart_resuirements (R2017b)

## 1 [ST_01] Activate
Start CC

### 1.1 [ST_01_01] Set required speed

### 1.2 [ST_01_02] Deactivate
Stop CC

### 1.3 [ST_04_01] Reduce speed with break
Break -> CC suspended

#### 1.3.1 [ST_04_02] Resume CC after break
Reactivate CC

#### 1.3.2 [ST_04_03] Deactivate CC after break
Deactivate CC

### 1.4 [ST_05_01] Suspend CC when transmission is out of top gear
Shift out of top gear

#### 1.4.1 [ST_05_02] Resume CC when transmission is back in top gear
Reactivate CC

#### 1.4.2 [ST_05_03] Deactive CC after transmission when out of top gear
Deactivate CC

### 1.5 [ST_06] Maintain speed

## 2 [ST_02] Show speed
Show Driving speed

## 3 [ST_03_01] Accelerate with pedal
Driver may go faster

### 3.1 [ST_03_02] Back to CC set speed
Back to CC at previous